# Grasshopper definition model_work_used.gh (Grasshopper 1.0.7)
# plug-ins: RhinoCodePluginGH, eleFront, Human

clear_spare = Button()

query_model_layers = QueryModelLayers(AutoUpdateState=False)
bake = BooleanToggle(True)
export = BooleanToggle(True)
path = Panel("F:\Rhino_File\exam01")

thick = Button()
material_name = Panel("Q390")
elastic = Panel("206000,0.3")
plastic = Panel("390,0,450,0.1")
material = Button()

resource_python_script = Panel("C:\Users\18328\Desktop\Rhino_Python - 20240104")
mesh_size = Slider(50, range=0..100)
generate_script = BooleanToggle(True)
run_script = BooleanToggle(True)
file_path = FilePath(resource_python_script)

colour_rgb = ColourRGB(Alpha=255, Red=255, Green=200, Blue=300)
create_modify_layers = CreateModifyLayers(LayerName="will_be_delet2", LayerColor=colour_rgb, DeleteLayer=False, enableFullPath=False)  # -> LayerNames, LayerFullPath
deleteonlayer = DeleteOnLayer(Run=clear_spare, Layer="will_be_delet2", enableFullPath=False)
createattributes = CreateAttributes(LayerName=create_modify_layers.LayerNames, enableFullPath=False)

model_layer = ModelLayer(Layer=query_model_layers)  # -> Layer, Name, Hidden
judge = Script(x=model_layer.Name, y=model_layer.Hidden, z="will_be_delet2")  # -> out, a
# ---------- judge: Python ----------
"""Grasshopper Script"""
if (not y) and (x!=z):
    a = x
else:
    a = None
# ---------- end judge ----------
create_set = CreateSet(List=judge.a)  # -> Set, Map
get_objects_in_this_layer = Script(layer=create_set.Set)  # -> out, objs
# ---------- get_objects_in_this_layer: Python ----------
import scriptcontext as sc
import Rhino
import GhPython
import rhinoscriptsyntax as  rs
sc.doc = Rhino.RhinoDoc.ActiveDoc




objs = rs.ObjectsByLayer(layer, True)
print(objs)


ghdoc = GhPython.DocReplacement.GrasshopperDocument()
sc.doc = ghdoc
# ---------- end get_objects_in_this_layer ----------
model_object = ModelObject(Object=get_objects_in_this_layer.objs)  # -> Object, Geometry, Layer
filter_by_type = FilterByType(ObjectType="Brep", Geometry=model_object.Geometry, invertFilter=False, returnNulls=False)  # -> ExcludedGeometry, IncludedGeometry
bake_objects = BakeObjects(Geometry=filter_by_type.IncludedGeometry, Bake=bake, createGroups=False)  # -> Message, Guids
list_length = ListLength(List=filter_by_type.IncludedGeometry)  # -> flatten(Length)
partition_list = PartitionList(List=bake_objects.Guids, Size=list_length)
script = Script(x=create_set.Set)  # -> out, a
# ---------- script: Python ----------
"""Grasshopper Script"""
a = x.split('-')[0]
# ---------- end script ----------
文件格式 = Panel(".stp")
export_generic = ExportGeneric(
    FolderPath=path,
    FileName=graft(script.a),
    FileExtension=文件格式,
    RhinoObjects=partition_list,
    AxisSystem=PlaneXY(0, 0, 0),
    Export=export,
    Overwrite=False,
    networkMode=True)

file_path_2 = FilePath(path)
thickness = Script(path=file_path_2, layer_name=create_set.Set, start=thick)  # -> out
# ---------- thickness: Python ----------
"""Grasshopper Script"""
import os

Project_name = 'A-name-thick'

if start:
    name_material_eleType = str(Project_name)+ '.txt'

    abs_path = os.path.join(path, name_material_eleType)

    layer = layer_name.split('-')[0]
    thick = layer_name.split('-')[-1][0:-2]
    print(layer, thick)

    file = open(abs_path,"a") # “w”表示写入 “w+”表示读取和写入
    file.write(str(layer)+' '+str(thick)+'\n')
	
    # 注意关闭文件
    file.close()

    print('Yep!')
# ---------- end thickness ----------
material_2 = Script(path=file_path_2, name=material_name, elastic=elastic, plastic=plastic, start=material)  # -> out
# ---------- material_2: Python ----------
"""Grasshopper Script"""
import os

Project_name = 'A-material'

if start:
    name_material_eleType = str(Project_name)+ '.txt'

    abs_path = os.path.join(path, name_material_eleType)

    elastic_num = elastic.split(',')
    plastic_num = plastic.split(',')
    print(elastic_num)
    print(plastic_num)

    file = open(abs_path,"a") # “w”表示写入 “w+”表示读取和写入
    file.write(str(name)+'\n')
    file.write(str(elastic_num[0])+' '+str(elastic_num[1])+'\n')
    file.write(str(plastic_num[0])+' '+str(plastic_num[1])+' '+str(plastic_num[2])+' '+str(plastic_num[3])+'\n')
    # 注意关闭文件
    file.close()
    print('Yep!')
# ---------- end material_2 ----------

file_path_3 = FilePath(path)
rhino2abaqus = Script(path_project=file_path_3, path_python_txt=file_path, size_mesh=mesh_size, start=generate_script)  # -> out
# ---------- rhino2abaqus: Python ----------
import os


def get_material_and_thick(path):
    """
    读取文件
    :param path: 文件所在的文件夹
    :return:
    """
    txt_material = os.path.join(path, 'A-material.txt')
    txt_thick = os.path.join(path, 'A-name-thick.txt')

    with open(txt_material, 'r') as file:
        content = file.read()
    material_Q = []
    for line in content.split('\n'):
        if line:
            material_Q.append(line)
    dict_material = {'name': str(material_Q[0]),
                     'elastic': [float(i) for i in material_Q[1].split(' ')],
                     'plastic': [float(j) for j in material_Q[2].split(' ')]}

    print('Material')
    print(dict_material)

    with open(txt_thick, 'r') as file:
        content = file.read()
    dict_layer_thick = {}
    for line in content.split('\n'):
        if line:
            [layer_, thick_] = (int(i) for i in line.split(' '))
            dict_layer_thick[layer_] = thick_

    print('Layer_thick')
    print(dict_layer_thick)

    return dict_material, dict_layer_thick


def pair_list(numbers):
    """make pair """
    assert len(numbers) % 2 == 0, ' Material data error！'
    return list(zip(numbers[::2], numbers[1::2]))


def make_Abaqus_txt(path_python_txt, path_files, dict_material, dict_layer_thick, size_mesh):
    path_abs = os.path.join(path_files, 'A-abaqus')  # cae文件及其所在位置

    path_python_txt_abs = os.path.join(path_files, 'A-Joint_make_abaqus.py')

    # delete the existed script
    if os.path.exists(path_python_txt_abs):
        os.remove(path_python_txt_abs)
        print('Have deleted the script used !')

    # 建立CAE文件
    fileTemp = ''
    with open(os.path.join(path_python_txt, 'Function_txt_abaqus_start.py'), "r", encoding="utf-8") as f:
        for line in f:
            if 'Path_define' in line:
                line = line.replace('Path_define', str(path_abs))

            fileTemp += line
    with open(path_python_txt_abs, "a", encoding="utf-8") as f:
        f.write(fileTemp)

    # 建立材料
    # #数据处理
    list_elastic = tuple(pair_list(dict_material['elastic']))
    list_plastic = tuple(pair_list(dict_material['plastic']))

    fileTemp = ''
    with open(os.path.join(path_python_txt, 'Function_txt_abaqus_material.py'), "r", encoding="utf-8") as f:
        for line in f:
            if 'Material_Name' in line:
                line = line.replace('Material_Name', str(dict_material['name']))
            if 'Elastic_replace' in line:
                line = line.replace('Elastic_replace', str(list_elastic))
            if 'Plastic_replace' in line:
                line = line.replace('Plastic_replace', str(list_plastic))

            fileTemp += line
    with open(path_python_txt_abs, "a", encoding="utf-8") as f:
        f.write(fileTemp)

    # 导入Stp 并赋予材料以及划分网格
    # #构件以layer_dict为准
    for layer_ele, thick_els in dict_layer_thick.items():
        path_stp_abs = os.path.join(path_files, str(layer_ele) + '.stp')

        fileTemp = ''  # avoid the repeat
        with open(os.path.join(path_python_txt, 'Function_txt_abaqus_stp_material_mesh.py'), "r",
                  encoding="utf-8") as f:
            for line in f:
                if 'Path_Stp' in line:
                    line = line.replace('Path_Stp', str(path_stp_abs))
                if 'Part_Name' in line:
                    line = line.replace('Part_Name', str(layer_ele))
                if 'Thick_Section' in line:
                    line = line.replace('Thick_Section', str(int(thick_els)))
                if 'Material_Q' in line:
                    line = line.replace('Material_Q', str(dict_material['name']))
                if 'Size_Mesh' in line:
                    line = line.replace('Size_Mesh', str(int(size_mesh)))

                fileTemp += line
        with open(path_python_txt_abs, "a", encoding="utf-8") as f:
            f.write(fileTemp)

    # 装配
    # 坐标
    fileTemp = ''
    with open(os.path.join(path_python_txt, 'Function_txt_abaqus_assembly_start.py'), "r", encoding="utf-8") as f:
        for line in f:
            fileTemp += line

    with open(path_python_txt_abs, "a", encoding="utf-8") as f:
        f.write(fileTemp)

    # 部件
    for layer_ele, thick_els in dict_layer_thick.items():

        fileTemp = ''  # avoid the repeat
        with open(os.path.join(path_python_txt, 'Function_txt_abaqus_assembly_part.py'), "r",
                  encoding="utf-8") as f:
            for line in f:
                if 'Part_Name' in line:
                    line = line.replace('Part_Name', str(layer_ele))

                fileTemp += line
        with open(path_python_txt_abs, "a", encoding="utf-8") as f:
            f.write(fileTemp)

    # 保存模型
    fileTemp = ''
    with open(os.path.join(path_python_txt, 'Function_txt_abaqus_save.py'), "r", encoding="utf-8") as f:
        for line in f:
            fileTemp += line

    with open(path_python_txt_abs, "a", encoding="utf-8") as f:
        f.write(fileTemp)

    print('Have writen the script!')


if __name__ == '__main__':
    # 测试
    # path_project = r'F:\Rhino_File\Ex'
    # path_python_txt = r'C:\Users\18328\Desktop\Rhino_Python'
    # size_mesh = 200

    if start:
        dict_material, dict_layer_thick = get_material_and_thick(path_project)
        make_Abaqus_txt(path_python_txt, path_project, dict_material, dict_layer_thick, size_mesh)
# ---------- end rhino2abaqus ----------
run_abaqus_no_gui = Script(Start=run_script, path_project=file_path_3)  # -> out
# ---------- run_abaqus_no_gui: Python ----------
"""Grasshopper Script"""

import os

path_abs_py_txt = os.path.join(str(path_project), 'A-Joint_make_abaqus.py')

if Start:
    os.chdir(path_project)

    # get_odb
    order1 = 'abaqus cae nogui=' + str(path_abs_py_txt)

    print('Abauqs is modelling...')
    d1 = os.popen(order1)
    f1 = d1.read()
    print(f1)
    print('Complete!')
# ---------- end run_abaqus_no_gui ----------

panel = Panel(run_abaqus_no_gui)
